# Dynamo graph Home.dyn (Dynamo 0.8.2.2392)

code_block = CodeBlock { {"p1", "p2", "p3", "p4"}; }
code_block_2 = CodeBlock { 100; }
randomList = Math.RandomList(code_block_2)
code_block_3 = CodeBlock { 4; }
chop = List.Chop(randomList, code_block_3)
integer_slider = IntegerSlider(12, range=0..24 step 1)
getItemAtIndex = List.GetItemAtIndex(list=chop, index=integer_slider)
parallelCoordinates = ParallelCoordinates(code_block, getItemAtIndex, color=0, values="System.Collections.Generic.List`1[System.Collections.Generic.List`1[System.Double]]")
